# Dynamo graph Ejes_estación_01.dyn (Dynamo 2.1.0.7500)

# group: Coordenadas puntos X y Z
code_block = CodeBlock { 0; }
code_block_2 = CodeBlock { 5; }

# group: Coordenada Y
code_block_3 = CodeBlock { 0; }
code_block_4 = CodeBlock { 100; }
code_block_5 = CodeBlock { 4; }
range = Range(start=code_block_3, end=code_block_4, step=code_block_5)
watch = Watch(range)  # graph output

# group: Puntos
byCoordinates = Point.ByCoordinates(x=code_block, y=watch, z=code_block)
byCoordinates_2 = Point.ByCoordinates(x=code_block_2, y=watch, z=code_block)

# group: Líneas
byStartPointEndPoint = Line.ByStartPointEndPoint(startPoint=byCoordinates, endPoint=byCoordinates_2)

# group: Ejes Transversales
byLine = Grid.ByLine(line=byStartPointEndPoint)

# group: Coordenada Y
code_block_6 = CodeBlock { 0; }
code_block_7 = CodeBlock { 5; }
code_block_8 = CodeBlock { 2.5; }
range_2 = Range(start=code_block_6, end=code_block_7, step=code_block_8)
watch_2 = Watch(range_2)  # graph output

# group: Coordenadas puntos X y Z
code_block_9 = CodeBlock { 0; }
code_block_10 = CodeBlock { 100; }

# group: Puntos
byCoordinates_3 = Point.ByCoordinates(x=watch_2, y=code_block_9, z=code_block_9)
byCoordinates_4 = Point.ByCoordinates(x=watch_2, y=code_block_10, z=code_block_9)

# group: Líneas
byStartPointEndPoint_2 = Line.ByStartPointEndPoint(startPoint=byCoordinates_3, endPoint=byCoordinates_4)

# group: Ejes Longitudinales
byLine_2 = Grid.ByLine(line=byStartPointEndPoint_2)
